# Grasshopper definition Vessel_hops.gh (Grasshopper 1.0.8)
# plug-ins: Pufferfish, Parakeet, MetaHopper, eleFront5

# ---- group: Curve Points
height = Slider(20, range=1..20)
number_of_points = Slider(7, range=1..10)
# Vessel for CBDM project 2026
# by Lakzhmy Zaro
mainwidth = Slider(7, range=1..10)
height_2 = GetInteger(height, AtLeast=0, AtMost=1, Maximum=2147483647, Minimum=0, TreeAccess=True)
gene_pool = GenePool(Decimals=0, Maximum=10, Minimum=0, Value=[1, 0, 0, 4, 0, 5, 3, 5, 4, 0])
number_of_points_2 = GetInteger(number_of_points, AtLeast=0, AtMost=1, Maximum=2147483647, Minimum=0, TreeAccess=True)
construct_domain = ConstructDomain(DomainStart=0, DomainEnd=height_2)
negative = Negative(Value=mainwidth)
range = Range(Domain=construct_domain, Steps=number_of_points_2)
subtraction = Subtraction(A=negative, B=gene_pool)
shortest_list = ShortestList(ListListA=subtraction, ListListB=range, TrimMode=3)  # -> ListListA, ListListB
construct_point = ConstructPoint(XCoordinate=reverse(shortest_list.ListListA), YCoordinate=0, ZCoordinate=shortest_list.ListListB)

# ----
boolean_toggle = BooleanToggle(True)
unit_changer = UnitChanger(Apply=boolean_toggle, UnitIndex="9", ChangeScale=boolean_toggle)
panel = Panel(construct_point)
vector_xyz = VectorXYZ(XComponent=expr("-x", Slider(4, range=0..10)), YComponent=0, ZComponent=0)  # -> Vector, Length
curve_style = BooleanToggle(False)
curve_style_2 = GetBoolean(curve_style, AtLeast=1, AtMost=1, FalseValue="False", TreeAccess=False, TrueValue="True")
thickness = Slider(0.2, range=0.1..1)
pot_thickness = GetNumber(thickness, AtLeast=1, AtMost=1, Maximum=1.797693135e+308, Minimum=-1.797693135e+308, TreeAccess=False)
unit_z = UnitZ(Factor=Slider(2, range=0..10))

# ---- group: Wild? Ridge?
wild = BooleanToggle(False)

# ----
wild_2 = GetBoolean(wild, AtLeast=1, AtMost=1, FalseValue="False", TreeAccess=False, TrueValue="True")

# ---- group: old
bottom = Slider(4, range=0..10)  # disabled
point1 = Slider(10, range=0..10)  # disabled
point2 = Slider(8, range=0..10)  # disabled
point3 = Slider(1, range=0..10)  # disabled
top = Slider(2, range=0..10)  # disabled
mainwidth_2 = Slider(5, range=1..10)  # disabled
bottom_2 = GetNumber(bottom, AtLeast=1, AtMost=1, Maximum=1.797693135e+308, Minimum=-1.797693135e+308, TreeAccess=False)  # disabled
point1_2 = GetNumber(point1, AtLeast=1, AtMost=1, Maximum=1.797693135e+308, Minimum=-1.797693135e+308, TreeAccess=False)  # disabled
point2_2 = GetNumber(point2, AtLeast=1, AtMost=1, Maximum=1.797693135e+308, Minimum=-1.797693135e+308, TreeAccess=False)  # disabled
point3_2 = GetNumber(point3, AtLeast=1, AtMost=1, Maximum=1.797693135e+308, Minimum=-1.797693135e+308, TreeAccess=False)  # disabled
top_2 = GetNumber(top, AtLeast=1, AtMost=1, Maximum=1.797693135e+308, Minimum=-1.797693135e+308, TreeAccess=False)  # disabled
mainwidth_3 = GetNumber(mainwidth_2, AtLeast=1, AtMost=1, Maximum=1.797693135e+308, Minimum=-1.797693135e+308, TreeAccess=False)  # disabled
negative_2 = Negative(Value=mainwidth_3)  # disabled
subtraction_2 = Subtraction(A=negative_2, B=bottom_2)  # disabled
subtraction_3 = Subtraction(A=negative_2, B=point1_2)  # disabled
subtraction_4 = Subtraction(A=negative_2, B=point2_2)  # disabled
subtraction_5 = Subtraction(A=negative_2, B=point3_2)  # disabled
subtraction_6 = Subtraction(A=negative_2, B=top_2)  # disabled
panel_2 = Panel("10")  # disabled
panel_3 = Panel("20")  # disabled
panel_4 = Panel("30")  # disabled
panel_5 = Panel("40")  # disabled
construct_point_2 = ConstructPoint(XCoordinate=subtraction_2, YCoordinate=0, ZCoordinate=0)  # disabled
construct_point_3 = ConstructPoint(XCoordinate=subtraction_3, YCoordinate=0, ZCoordinate=panel_2)  # disabled
construct_point_4 = ConstructPoint(XCoordinate=subtraction_4, YCoordinate=0, ZCoordinate=panel_3)  # disabled
construct_point_5 = ConstructPoint(XCoordinate=subtraction_5, YCoordinate=0, ZCoordinate=panel_4)  # disabled
construct_point_6 = ConstructPoint(XCoordinate=subtraction_6, YCoordinate=0, ZCoordinate=panel_5)  # disabled
merge = Merge(
    Data1=construct_point_2,
    Data2=construct_point_3,
    Data3=construct_point_4,
    Data4=construct_point_5,
    Data5=construct_point_6)  # disabled
construct_point_7 = ConstructPoint(XCoordinate=0, YCoordinate=0, ZCoordinate=0)  # disabled
line = Line(StartPoint=construct_point_7, EndPoint=construct_point_2)  # disabled
interpolate = Interpolate(Vertices=merge, Degree=3, Periodic=False, KnotStyle=1)  # -> Curve, Length, Domain; disabled
flip_curve = FlipCurve(Curve=line)  # -> Curve, Flag; disabled
unit_z_2 = UnitZ(Factor=1)  # disabled
move = Move(Geometry=construct_point_7, Motion=unit_z_2)  # -> Geometry, Transform; disabled
line_2 = Line(StartPoint=construct_point_7, EndPoint=move.Geometry)  # disabled
group_toggle = GroupToggle(ToggleActive=True, ToggleVisible=False)  # disabled

# ---- group: old / SImple Vessel
join_curves = JoinCurves(Curves=[flip_curve.Curve, interpolate.Curve], Preserve=False)  # -> flatten(Curves); disabled
offset_curve = OffsetCurve(Curve=join_curves, Distance=1, Corners=1)  # -> flatten(Curve); disabled
end_points = EndPoints(Curve=join_curves)  # -> Start, End; disabled
end_points_2 = EndPoints(Curve=offset_curve)  # -> Start, End; disabled
line_3 = Line(StartPoint=end_points.Start, EndPoint=end_points_2.Start)  # disabled
join_curves_2 = JoinCurves(Curves=[join_curves, line_3, offset_curve], Preserve=False)  # disabled
revolution = Revolution(Curve=join_curves_2, Axis=line_2, Domain=Domain(0, 6.283185307))  # disabled
mesh_brep = MeshBrep(
    Brep=revolution,
    Settings={GridMaxCount=0, GridMinCount=16, JaggedSeams=False, MaxEdgeLength=0, MinEdgeLength=0.0001, MinTolerance=0, Refine=True, RefineAngle=0, RelativeTolerance=0.65, SimplePlanes=True, Tolerance=0})  # disabled

# ---- group: old / Ridged Vessel
ridgedepth = Slider(1.2, range=0.6..1.8)  # disabled
ridges = Slider(22, range=6..100)  # disabled
circle = Circle(Plane=PlaneXY(0, 0, 0), Radius=subtraction_2)  # disabled
number_slider = Slider(0.5, range=0..1)  # disabled

# ---- group: old (continued)
ridgedepth_2 = GetNumber(ridgedepth, AtLeast=1, AtMost=1, Maximum=1.797693135e+308, Minimum=-1.797693135e+308, TreeAccess=False)  # disabled
ridges_2 = GetNumber(ridges, AtLeast=1, AtMost=1, Maximum=1.797693135e+308, Minimum=-1.797693135e+308, TreeAccess=False)  # disabled

# ---- group: old / Ridged Vessel (continued)
divide_curve = DivideCurve(Curve=circle, Count=ridges_2, Kinks=False)  # -> Points, Tangents, Parameters; disabled
dispatch = Dispatch(List=divide_curve.Points, DispatchPattern=[True, False])  # -> ListA, ListB; disabled
scale = Scale(Geometry=dispatch.ListA, Center=Point(0, 0, 0), Factor=ridgedepth_2)  # -> Geometry, Transform; disabled
weave = Weave(Pattern=[0, 1], Stream0=scale.Geometry, Stream1=dispatch.ListB, NullGaps=False)  # disabled
interpolate_2 = Interpolate(Vertices=weave, Degree=3, Periodic=invert(False), KnotStyle=1)  # -> Curve, Length, Domain; disabled
rail_revolution = RailRevolution(Curve=interpolate_2.Curve, Rail=interpolate.Curve, Axis=line_2, Scale=False)  # disabled
brep_edges = BrepEdges(Brep=rail_revolution)  # -> Naked, Interior, NonManifold; disabled
list_item = ListItem(List=brep_edges.Naked, Index=expr("x+1", 0), Wrap=True)  # disabled
surface = Surface(list_item)  # disabled
brep_join = BrepJoin(Breps=flatten([rail_revolution, surface]))  # -> Breps, Closed; disabled
offset_mesh = OffsetMesh(Mesh=brep_join.Breps, Distance=number_slider, BothSides=0, CreateSolid=True)  # disabled

# ---- group: old / center
geometry = Geometry(offset_mesh)  # disabled
area = Area(Geometry=geometry)  # -> Area, Centroid; disabled
construct_point_8 = ConstructPoint(XCoordinate=0, YCoordinate=0, ZCoordinate=0)  # disabled
vector_2pt = Vector2Pt(PointA=area.Centroid, PointB=construct_point_8, Unitize=False)  # -> Vector, Length; disabled
move_2 = Move(Geometry=geometry, Motion=vector_2pt.Vector)  # -> Geometry, Transform; disabled

# ---- group: old (continued)
context_bake = ContextBake(Geometry=move_2.Geometry)  # disabled

# ---- group: center
geometry_2 = Geometry(construct_point)

# ----
bounding_box = BoundingBox(Content=geometry_2, Plane=PlaneXY(0, 0, 0), UnionBox=True)  # -> Box, Box_2

# ---- group: center (continued)
area_2 = Area(Geometry=bounding_box.Box)  # -> Area, Centroid
deconstruct = Deconstruct(Point=area_2.Centroid)  # -> XComponent, YComponent, ZComponent
construct_point_9 = ConstructPoint(XCoordinate=deconstruct.XComponent, YCoordinate=0, ZCoordinate=0)
vector_2pt_2 = Vector2Pt(PointA=area_2.Centroid, PointB=construct_point_9, Unitize=False)  # -> Vector, Length
move_3 = Move(Geometry=geometry_2, Motion=vector_2pt_2.Vector)  # -> Geometry, Transform

# ---- group: Gumball Points
points = GetPoint(move_3.Geometry, AtLeast=1, AtMost=1, Realtime=True, TreeAccess=False)

# ----
move_4 = Move(Geometry=points, Motion=vector_xyz.Vector)  # -> Geometry, Transform
sphere = Sphere(Base=move_4.Geometry, Radius=Slider(0.8, range=0..1))

# ---- group: Axis & Bottom
list_item_2 = ListItem(List=points, Index=0, Wrap=True)
deconstruct_2 = Deconstruct(Point=list_item_2)  # -> XComponent, YComponent, ZComponent
construct_point_10 = ConstructPoint(XCoordinate=0, YCoordinate=0, ZCoordinate=deconstruct_2.ZComponent)
unit_z_3 = UnitZ(Factor=1)
move_5 = Move(Geometry=construct_point_10, Motion=unit_z_3)  # -> Geometry, Transform
line_4 = Line(StartPoint=construct_point_10, EndPoint=list_item_2)
line_5 = Line(StartPoint=construct_point_10, EndPoint=move_5.Geometry)

# ----
interpolate_3 = Interpolate(Vertices=points, Degree=3, Periodic=False, KnotStyle=expr("1", 1))  # -> Curve, Length, Domain
nurbs_curve = NurbsCurve(Vertices=points, Degree=3, Periodic=False)  # -> Curve, Length, Domain
stream_filter = StreamFilter(Gate=curve_style_2, Stream0=nurbs_curve.Curve, Stream1=interpolate_3.Curve)

pipe = Pipe(Curve=stream_filter, Radius=Slider(0.1, range=0..1), Caps=2, FitRail=False)
mesh = Mesh(pipe)
context_bake_2 = ContextBake(ProfileCurve=mesh)

profile_curve = GetGeometry(stream_filter, AnnotationTypeFilter=3966, AtLeast=1, AtMost=1, DeleteInput=False, Filter=1074081855, TreeAccess=False)  # disabled
stream = EleFrontDataDescription(stream_filter, ShiftDepth=0, isNameSet=False)

# ---- group: Ridged Vessel
ridgedepth_3 = Slider(1.4, range=0.5..1.5)
ridges_3 = Slider(26, range=4..40)
ridge_depth = GetNumber(ridgedepth_3, AtLeast=1, AtMost=1, Maximum=1.797693135e+308, Minimum=-1.797693135e+308, TreeAccess=False)
ridges_4 = GetNumber(ridges_3, AtLeast=1, AtMost=1, Maximum=1.797693135e+308, Minimum=-1.797693135e+308, TreeAccess=False)
circle_2 = Circle(Plane=PlaneXY(0, 0, 0), Radius=mainwidth)
divide_curve_2 = DivideCurve(Curve=circle_2, Count=ridges_4, Kinks=False)  # -> Points, Tangents, Parameters
dispatch_2 = Dispatch(List=divide_curve_2.Points, DispatchPattern=[True, False])  # -> ListA, ListB
scale_2 = Scale(Geometry=dispatch_2.ListA, Center=Point(0, 0, 0), Factor=ridge_depth)  # -> Geometry, Transform
weave_2 = Weave(Pattern=[0, 1], Stream0=scale_2.Geometry, Stream1=dispatch_2.ListB, NullGaps=False)
interpolate_4 = Interpolate(Vertices=weave_2, Degree=3, Periodic=invert(False), KnotStyle=1)  # -> Curve, Length, Domain
rail_revolution_2 = RailRevolution(Curve=interpolate_4.Curve, Rail=stream, Axis=line_5, Scale=False)
brep_edges_2 = BrepEdges(Brep=rail_revolution_2)  # -> Naked, Interior, NonManifold
list_item_3 = ListItem(List=brep_edges_2.Naked, Index=expr("x+1", 0), Wrap=True)
surface_2 = Surface(list_item_3)
brep_join_2 = BrepJoin(Breps=flatten([rail_revolution_2, surface_2]))  # -> Breps, Closed
quad_remesh_settings = QuadRemeshSettings(TargetCount=1000, AdaptiveSize=0, AdaptiveCount=False, HardEdges=False, SeamEdges=0, Symmetry=0, GuideCurves=0)
quad_remesh = QuadRemesh(Geometry=brep_join_2.Breps, Settings=quad_remesh_settings)
flip_mesh = FlipMesh(Mesh=quad_remesh, VertexNormals=True, FaceNormals=True, FaceOrientation=True)
offset_mesh_2 = OffsetMesh(Mesh=flip_mesh, Distance=pot_thickness, BothSides=0, CreateSolid=True)
move_6 = Move(Geometry=offset_mesh_2, Motion=unit_z)  # -> Geometry, Transform

# ---- group: Rib Tool
rib_width = Slider(4, range=0..10)
rib_width_2 = GetNumber(rib_width, AtLeast=1, AtMost=1, Maximum=1.797693135e+308, Minimum=-1.797693135e+308, TreeAccess=False)
unit_x = UnitX(Factor=rib_width_2)
move_7 = Move(Geometry=stream, Motion=expr("-x", unit_x))  # -> Geometry, Transform
loft = Loft(
    Curves=[move_7.Geometry, stream],
    Options={Adjust=False, Closed=False, LoftEnds=0, LoftSimp=0, LoftType=0, Rebuild=10, Refit=0.01})
rotate_axis = RotateAxis(Geometry=loft, Angle=expr("-x", 1.570796327), Axis=Line((0, 0, 0), (10, 0, 0)))  # -> Geometry, Transform
unit_z_4 = UnitZ(Factor=expr(".2", 1))
extrude = Extrude(Base=rotate_axis.Geometry, Direction=unit_z_4)
area_3 = Area(Geometry=extrude)  # -> Area, Centroid
construct_point_11 = ConstructPoint(XCoordinate=0, YCoordinate=0, ZCoordinate=0)
vector_2pt_3 = Vector2Pt(PointA=area_3.Centroid, PointB=construct_point_11, Unitize=False)  # -> Vector, Length
move_8 = Move(Geometry=extrude, Motion=vector_2pt_3.Vector)  # -> Geometry, Transform
mesh_2 = Mesh(move_8.Geometry)

# ---- group: SImple Vessel
join_curves_3 = JoinCurves(Curves=[line_4, stream], Preserve=False)  # -> flatten(Curves)
offset_curve_2 = OffsetCurve(Curve=join_curves_3, Distance=pot_thickness, Corners=1)  # -> flatten(Curve)
end_points_3 = EndPoints(Curve=offset_curve_2)  # -> Start, End
end_points_4 = EndPoints(Curve=join_curves_3)  # -> Start, End
line_6 = Line(StartPoint=end_points_4.End, EndPoint=end_points_3.End)
join_curves_4 = JoinCurves(Curves=[join_curves_3, line_6, offset_curve_2], Preserve=False)
settings_custom = SettingsCustom(
    StitchSeams=True,
    SimplePlanes=False,
    Refine=True,
    MinCount=16,
    MaxCount=400,
    AspectRatio=20,
    MaxDistance=0,
    MaxAngle=20,
    MinEdge=0,
    MaxEdge=0)
revolution_2 = Revolution(Curve=join_curves_4, Axis=line_5, Domain=Domain(0, 6.283185307))
mesh_brep_2 = MeshBrep(Brep=revolution_2, Settings=settings_custom)
flip_mesh_2 = FlipMesh(Mesh=mesh_brep_2, VertexNormals=True, FaceNormals=True, FaceOrientation=True)

# ----
volume = Volume(Geometry=move_8.Geometry)  # -> Volume, Centroid
panel_6 = Panel(volume.Volume)
context_print = ContextPrint(RibToolVolume=volume.Volume)

# ---- group: Rib Tool
context_bake_3 = ContextBake(RibToolOutput=move_8.Geometry)
context_bake_4 = ContextBake(RibTool=mesh_2)

# ----
stream_filter_2 = StreamFilter(Gate=wild_2, Stream0=flip_mesh_2, Stream1=move_6.Geometry)
face_normals = FaceNormals(Mesh=offset_mesh_2)  # -> Centers, Normals

volume_2 = Volume(Geometry=stream_filter_2)  # -> Volume, Centroid
panel_7 = Panel(volume_2.Volume)
context_print_2 = ContextPrint(MaterialVolume=volume_2.Volume)

vector_display = VectorDisplay(Anchor=face_normals.Centers, Vector=face_normals.Normals)
context_bake_5 = ContextBake(Geometry=stream_filter_2)
